% Requirement links of TestingScript.m (R2025b)

% line 8 verifies Requirements.slreqx#42
        function verifyWingUnfoldedSpan(testCase)

% line 12 verifies Requirements.slreqx#43
        function verifyWingFoldedSpan(testCase)

% line 17 verifies Requirements.slreqx#45
        function verifyAircraftHeight(testCase)

% line 22 verifies Requirements.slreqx#44
        function verifyAircraftLength(testCase)

% line 26 verifies Requirements.slreqx#8
        function verifyNumEngines(testCase)

% line 30 verifies Requirements.slreqx#36
        function verifyDesignLoadFactor(testCase)